# Grasshopper definition 01_KurulumveTemelBilgiler.gh (Grasshopper 1.0.7)

number_slider = Slider(4, range=0..10)
pt = ConstructPoint(XCoordinate=0, YCoordinate=0, ZCoordinate=0)
pt_2 = ConstructPoint(XCoordinate=number_slider, YCoordinate=number_slider, ZCoordinate=0)
python = GhPythonScript(point1=pt, point2=pt_2)  # -> output; inputs point2: Point3d
# ---------- python: Python ----------
import rhinoscriptsyntax as rs
import ghpythonlib.components as ghcomp

point1=rs.coerce3dpoint(point1)

output=ghcomp.Line(point1,point2)
# ---------- end python ----------
python_2 = GhPythonScript(input="herkese")  # -> output
# ---------- python_2: Python ----------
#print("Hello Metametrik")

def sayHello(name):
    return "hello "+name
    
output=sayHello(input)
# ---------- end python_2 ----------
panel = Panel(python)
