# Grasshopper definition 02_VeriTipleriveMatematikselIslemler.gh (Grasshopper 1.0.7)

panel = Panel("""12
2
0""")
range = Range(Domain=Domain(0, 10), Steps=10)
python = GhPythonScript(string="123", Float=Slider(12.5, range=0..100), integer=Slider(5, range=0..10), Boolean=Toggle(False), Liste=range)  # -> out, a; inputs integer: Int32, Liste: list
# ---------- python: Python ----------
a=Liste
print(a)
print(type(a))
# ---------- end python ----------
python_2 = GhPythonScript(input0=panel)  # -> out, a
# ---------- python_2: Python ----------
import ghpythonlib.components as ghcomp
input0=input0.split()

result=input0[1]
#print(input0)
#print(type(input0))
#print(result)
#print(type(result))

#x=input0[0]
#y=input0[1]
#z=input0[2]

x,y,z=input0[0],input0[1],input0[2]

a=ghcomp.ConstructPoint(x,y,z)
# ---------- end python_2 ----------
pt = ConstructPoint(XCoordinate=Slider(12, range=0..100), YCoordinate=Slider(15, range=0..100), ZCoordinate=Slider(0, range=0..100))
panel_2 = Panel(python.out)
panel_3 = Panel(python.a)
